# Grasshopper definition inner_hops_definition.gh (Grasshopper 1.0.8)

n1 = GetNumber("4", AtLeast=1, AtMost=1, Maximum=1.797693135e+308, Minimum=-1.797693135e+308, TreeAccess=False)
n2 = GetNumber("4", AtLeast=1, AtMost=1, Maximum=1.797693135e+308, Minimum=-1.797693135e+308, TreeAccess=False)
num = Number(n1)
num_2 = Number(n2)
addition = Addition(A=num, B=num_2)
subtract = Subtract(A=num, B=num_2)
multiply = HopsTestMultiply(A=addition, B=subtract)
divide = HopsTestDivide(A=multiply, B="3")

# ---- group: RH_OUT:Addition_Result
num_3 = Number(divide)

# ----
panel = Panel(num_3)

# ==== cluster HopsTestMultiply
B = ClusterInput()
A = ClusterInput()
multiplication = Multiplication(A=A, B=B)
R = ClusterOutput(multiplication)

# ==== cluster HopsTestDivide
B = ClusterInput()
A = ClusterInput()
division = Division(A=A, B=B)
R = ClusterOutput(division)

# ==== cluster Subtract
A = ClusterInput()
B = ClusterInput()
subtraction = Subtraction(A=A, B=B)
R = ClusterOutput(subtraction)
