# Grasshopper definition outer_hops_definition.gh (Grasshopper 1.0.8)
# plug-ins: Hops

n2 = GetNumber("2", AtLeast=1, AtMost=1, Maximum=1.797693135e+308, Minimum=-1.797693135e+308, TreeAccess=False)
n1 = GetNumber("2", AtLeast=1, AtMost=1, Maximum=1.797693135e+308, Minimum=-1.797693135e+308, TreeAccess=False)
num = Number(n2)
num_2 = Number(n1)
multiply = HopsTestMultiply(A=num_2, B=num)
subtract = Subtract(A=num_2, B=num)
divide = HopsTestDivide(A=subtract, B="2")
hops = Hops(
    N1=multiply,
    N2=divide,
    CacheResultsInMemory=True,
    CacheSolveResults=True,
    RemoteDefinitionLocation="inner_hops_definition/2",
    RemoteSolveVersion=(0, 1, 0),
    ShowInput_Enabled=False,
    ShowInput_Path=False,
    SynchronousSolve=True)
cluster = HopsTestAbsolute(x=hops)

# ---- group: RH_OUT:Addition_Result
num_3 = Number(cluster)

# ----
panel = Panel(num_3)

# ==== cluster Subtract
A = ClusterInput()
B = ClusterInput()
subtraction = Subtraction(A=A, B=B)
R = ClusterOutput(subtraction)

# ==== cluster HopsTestMultiply
B = ClusterInput()
A = ClusterInput()
multiplication = Multiplication(A=A, B=B)
R = ClusterOutput(multiplication)

# ==== cluster HopsTestDivide
B = ClusterInput()
A = ClusterInput()
division = Division(A=A, B=B)
R = ClusterOutput(division)

# ==== cluster HopsTestAbsolute
x = ClusterInput()
abs = Absolute(Value=x)
y = ClusterOutput(abs)
