# Grasshopper definition three_way_addition.gh (Grasshopper 1.0.8)
# Description for the Three Way Addition hopsable file.

C = GetNumber(AtLeast=1, AtMost=1, Maximum=1.797693135e+308, Minimum=-1.797693135e+308, TreeAccess=False)
B = GetNumber(AtLeast=1, AtMost=1, Maximum=1.797693135e+308, Minimum=-1.797693135e+308, TreeAccess=False)
A = GetNumber(AtLeast=1, AtMost=1, Maximum=1.797693135e+308, Minimum=-1.797693135e+308, TreeAccess=False)
addition = Addition(A=A, B=B, C=C)

# ---- group: RH_OUT:Result
num = Number(addition)

# ----
panel = Panel(addition)
